# Grasshopper definition Grasshopper_Weaving.gh (Grasshopper 0.9.76)
# plug-ins: K2Collisions

mesh = Mesh(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)
mesh_2 = Mesh(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)
mesh_3 = Mesh(mesh)
mesh_4 = Mesh(mesh_3)

values = Values(
    ClothedEdges=Slider(0.4, range=0.001..100),
    NakedEdges=Slider(0.1, range=0.001..100),
    SpringsStrength=Slider(10, range=0.001..100),
    HingeStrength=Slider(10, range=0.001..100),
    CollisionRadius=Slider(0.05, range=0.001..100),
    CollisionStrength=Slider(75, range=0.001..100),
    OffsetSpatialHash=Slider(5, range=0.001..100))
collision_box = CollisionBox(Mesh=mesh_4, Inflate=Slider(1, range=0.1..11.1), BinScale=Slider(1, range=0..1))  # -> BoundingBox, Subdivisions
mesh_5 = Mesh(mesh_3)

k2_pl_gh = K2Plankton(
    Reset=Button(),
    On=Toggle(False),
    Mesh=mesh_5,
    Values=values,
    BoundingBox=collision_box.BoundingBox,
    Subdivisions=collision_box.Subdivisions,
    Threading=Toggle(False),
    ValenceX4Anchors=Toggle(True))  # -> Mesh, Positions
c_script = CSharpScript(x=k2_pl_gh.Positions)  # -> out, A; disabled
# ---------- c_script: C# ----------
    A = x;
# ---------- end c_script ----------
