# Grasshopper definition WeavingGrowt.gh (Grasshopper 0.9.76)
# plug-ins: MeshEdit Components, PolyMesh_Physics, Ninjaroo, Kangaroo Components, PlanktonGh, Weaverbird, SelectablePreview, Kangaroo2 Components, K2Collisions, PolyMesh_GH

# ---- group: generate
number_slider = Slider(2, range=0..100)
number_slider_2 = Slider(4566568, range=0..100000000)
random = Random(Range=Slider(227753, range=0..1000000), Number=number_slider, Seed=number_slider_2, Integers=True)
random_2 = Random(Range=".4 to .6", Number=number_slider, Seed=number_slider_2)
addition = Addition(A=random, B=random_2)
topobuild = TopologyBuilder(
    Instructions=addition,
    Radius=5,
    Height=Slider(2, range=0..10),
    Collapse=Slider(1, range=0..2),
    Minimal=Slider(10, range=0..100),
    MinOpt=True)  # -> Curves, Values, Faces

# ----
values = Integer(flatten(topobuild.Values))
int = Integer(flatten(topobuild.Faces))

# ---- group: relax
end = EndPoints(Curve=topobuild.Curves)  # -> Start, End
number_slider_3 = Slider(13.334, range=0..100)
cullpt = CullDuplicates(Points=flatten([end.Start, end.End]), Tolerance=0.1, CullMode=3)  # -> Points, Indices, Valence
ln = Line(StartPoint=end.Start, EndPoint=end.End)
length_line = LengthLine(Line=flatten(ln), Length=number_slider_3, Strength=10)
sc = SphereCollide(Points=cullpt.Points, Radius=number_slider_3, Strength=Slider(5.09, range=0..100))
zombiesolver = ZombieSolver(GoalObjects=[length_line, sc], Threshold=1e-10, Tolerance=0.01, MaxIterations=50000)  # -> I, V, O
clean = CleanTree(RemoveNulls=True, RemoveInvalid=True, RemoveEmpty=False, Tree=zombiesolver.O)

# ---- group: orient
eval = EvaluateCurve(Curve=reparameterize(clean), Parameter="0.5")  # -> Point, Tangent, Angle
end_2 = EndPoints(Curve=clean)  # -> Start, End
item = ListItem(List=reverse(end_2.End), Index=0, Wrap=True)
avr = Average(Input=eval.Point)
item_2 = ListItem(List=end_2.Start, Index=0, Wrap=True)
yz = YZPlane(Origin=Point(0, 0, 0))
pl_3pt = Plane3Pt(PointA=item_2, PointB=item, PointC=avr)
orient = Orient(Geometry=clean, Source=pl_3pt, Target=yz)  # -> Geometry, Transform

# ----
lng = ListLength(List=int)
dup = DuplicateData(Data=Slider(30, range=0..100), Number=lng, Order=True)

# ---- group: mesh
wrap = WrapTopology(Lines=orient.Geometry, Values=values, Faces=int, Truncate=Slider(0.2, range=0..1))

# ----
nakede = NakedEdges(PolyMesh=wrap, Manifold=True)
cp = ControlPoints(Curve=nakede)  # -> Points, Weights, Knots
lng_2 = ListLength(List=cp.Points)  # -> flatten(Length)
smooth = Smooth(M=wrap, Strength=Slider(0.95, range=0..10))
floor = Floor(Strength=1)
sort = SortList(Keys=lng_2, ValuesA=nakede)  # -> Keys, reverse(ValuesA)
relax = RelaxPolyMesh(PolyMesh=wrap, Edge=Slider(1, range=0..1), Anchor=Slider(100, range=0..10000), Speed="0.95", Stretch="0.001")
eval_2 = EvaluateCurve(Curve=reparameterize(orient.Geometry), Parameter=Slider(0.5, range=0..1))  # -> Point, Tangent, Angle
pressure = Pressure(M=wrap, Strength=Slider(0, range=0..0.1))
item_3 = ListItem(List=sort.ValuesA, Index=0, Wrap=True)  # -> Item, Item1
tag = TextTag3D(Location=eval_2.Point, Size=1, Justification=7)
number_slider_4 = Slider(10000, range=0..10000)
disc = Discontinuity(Curve=item_3.Item1, Level=1)  # -> Points, Parameters
disc_2 = Discontinuity(Curve=item_3.Item, Level=1)  # -> Points, Parameters
C = Coincident(Point0=disc_2.Points, Point1=disc.Points, Strength=Slider(0, range=0..1))
merge = Merge(Data1=flatten(relax), Data2=flatten(C), Data3=flatten(smooth), Data4=flatten(pressure), Data5=flatten(floor))
ninjaroo = NinjaKangaroo(Goals=merge, Tolerance=0.01, Energy=0, Reset=Button(), Run=Toggle(False), geo=False)  # -> Iterations, Positions, Outputs
item_4 = ListItem(List=ninjaroo.Outputs, Index=0, Wrap=True)
mesh = Mesh(<mesh referenced from the Rhino model>)
mesh_2 = Mesh(<mesh referenced from the Rhino model>)
wbframe = WeaverbirdsPictureFrame(MeshPolylines=mesh, Distance=Slider(12, range=0..21), InsetType=0)
item_5 = ListItem(
    List=[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, "Grasshopper.Kernel.Types.GH_ObjectWrapper", "Grasshopper.Kernel.Types.GH_ObjectWrapper", "Grasshopper.Kernel.Types.GH_ObjectWrapper", "Grasshopper.Kernel.Types.GH_ObjectWrapper", "Grasshopper.Kernel.Types.GH_ObjectWrapper"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],
    Index=0,
    Wrap=True)
P = PolyMesh(mesh_2)
getedges = GetEdges(PolyMesh=P)  # -> Edges, Naked, Faces
lng_3 = ListLength(List=getedges.Naked)
selpv = SelectablePreview(
    Geometry=getedges.Edges,
    lock=True,
    maintain=False,
    selectedobject="{0;0}(230)|{0;0}(229)|{0;0}(195)|{0;0}(194)|{0;0}(1286)|{0;0}(1285)|{0;0}(273)|{0;0}(272)|{0;0}(176)|{0;0}(175)|{0;0}(131)|{0;0}(130)|{0;0}(3)|{0;0}(2)|{0;0}(116)|{0;0}(46)||")  # -> Geometry, Path, Index
repeat = RepeatData(Data="2", Length=lng_3)
number_slider_5 = Slider(0.079, range=0..10)
number_slider_6 = Slider(0, range=0..10)
c_script = CSharpScript(x=repeat, y=selpv.Index)  # -> out, A; inputs x: list of Int32, y: list of Int32
# ---------- c_script: C# ----------
    for(int i = 0; i < x.Count; i++)
      if(y.Contains(i))
        x[i] -= 2;

    A = x;
# ---------- end c_script ----------
weaver = Weaver(PolyMesh=mesh_2, Colors=repeat, Depth=0.1, Type=Slider(3, range=0..10), W2=Slider(3, range=0..10))  # -> Geometry, Connections
P_2 = PolyMesh(weaver.Geometry)
mesh_3 = Mesh(<mesh referenced from the Rhino model>)
joinweld = JoinWeld(PolyMesh=flatten(P_2), Weld=True)
mesh_4 = Mesh(joinweld)
clean_2 = CombineClean(Meshes=mesh_4)
wbjoin = WeaverbirdsJoinMeshesAndWeld(Mesh=flatten(clean_2), Weld=True)
unifynormals = MeshUnifyNormals(Mesh=wbjoin)
mesh_5 = Mesh(unifynormals)
mesh_6 = Mesh(unifynormals)

collision_box = CollisionBox(Mesh=mesh_5, Inflate=Slider(1, range=0.1..11.1), BinScale=Slider(1, range=0..1))  # -> BoundingBox, Subdivisions
toggle = BooleanToggle(False)
values_2 = Values(
    ClothedEdges=Slider(0.8, range=0.001..100),
    NakedEdges=Slider(0.6, range=0.001..100),
    SpringsStrength=Slider(10, range=0.001..100),
    HingeStrength=Slider(10, range=0.001..100),
    CollisionRadius=Slider(0.04, range=0.001..100),
    CollisionStrength=Slider(100, range=0.001..100),
    OffsetSpatialHash=Slider(2, range=0.001..100))
mesh_7 = Mesh(mesh_6)

k2_pl_gh = K2Plankton(
    Reset=Button(),
    On=Toggle(False),
    Mesh=mesh_7,
    Values=values_2,
    BoundingBox=collision_box.BoundingBox,
    Subdivisions=collision_box.Subdivisions,
    Threading=False,
    ValenceX4Anchors=Toggle(True))  # -> Mesh, Positions
pmesh = PlanktonMesh(k2_pl_gh.Mesh)
medges = MeshEdges(Mesh=pmesh)  # -> NakedEdges, InteriorEdges, NonManifoldEdges
mesh_8 = Mesh(pmesh)
crv = Curve(medges.NakedEdges)
mjoin = MeshJoin(Meshes=mesh_8)
c_script_2 = CSharpScript(t="C:\Users\pves\Downloads", m=mesh_8, s=Toggle(True), run=Button())  # inputs t: String, m: list of Mesh, c: list of Color, s: Boolean, run: Boolean
# ---------- c_script_2: C# ----------
    //Preview
    display = m;
    Mesh d = new Mesh();
    for(int i = 0; i < m.Count; i++)
      d.Append(m[i]);

    bbox = d.GetBoundingBox(false);

    colors = c;
    flag = s;





    //Bake

    if (run){

      List<Color> col_list = new List<Color>();
      List<int> i_list = new List<int>();

      for(int i = 0; i < m.Count; i++)
        i_list.Add(-1);



      for(int i = 0; i < m.Count; i++){
        if(!(i_list[i] == -1))
          continue;


        col_list.Add(c[i]);
        for(int j = 0; j < m.Count; j++){
          if(c[i] == c[j])
            i_list[j] = col_list.Count - 1;

        }
      }

      int width = (int) Math.Ceiling(Math.Sqrt(col_list.Count)) * 2;
      Bitmap bm = new Bitmap(width, width);
      Graphics gr = Graphics.FromImage(bm);
      gr.FillRectangle(new SolidBrush(Color.White), 0, 0, width, width);

      int ind = -1;

      for(int i = 0; i < width; i += 2){
        for(int j = 0; j < width; j += 2){
          ind++;
          if(ind > col_list.Count - 1)
            break;//Might not be correct. Was exit for

          Color col = col_list[ind];

          bm.SetPixel(i + 0, width - j - 1, col);
          bm.SetPixel(i + 1, width - j - 1, col);
          bm.SetPixel(i + 1, width - j - 2, col);
          bm.SetPixel(i + 0, width - j - 2, col);

          for(int k = 0; k < m.Count; k++){

            if(!(i_list[k] == ind))
              continue;

            m[k].TextureCoordinates.Clear();

            for(int f = 0; f < m[k].Vertices.Count; f++){
              m[k].TextureCoordinates.Add(new Point2f(((double) i + 1) / (double) width, ((double) j + 1) / (double) width));
            }


            Rhino.DocObjects.ObjectAttributes att = new Rhino.DocObjects.ObjectAttributes ();
            att.ObjectColor = col;
            att.ColorSource = Rhino.DocObjects.ObjectColorSource.ColorFromObject;
            att.LayerIndex = Rhino.RhinoDoc.ActiveDoc.Layers.CurrentLayerIndex;
            Rhino.RhinoDoc.ActiveDoc.Objects.AddMesh(m[k], att);
          }
        }
      }

      string fln = null;
      Rhino.UI.Dialogs.ShowEditBox("File name", "Must end with .png", "texture.png", false, out fln);
      bm.Save(t + "\\" + fln, System.Drawing.Imaging.ImageFormat.Png);


    }
# ---------- c_script_2: C# additional code ----------
  List<Mesh> display = new List<Mesh>();
  List<Color> colors = new List<Color>();
  bool flag;

  BoundingBox bbox = new BoundingBox();
  Rhino.Display.DisplayMaterial material = new Rhino.Display.DisplayMaterial(Color.FromArgb(255, 255, 255));

  //Return a BoundingBox that contains all the geometry you are about to draw.
  public override BoundingBox ClippingBox
  {
    get
    {
      return bbox;
    }
  }

  //Draw all meshes in this method.
  public override void DrawViewportMeshes(IGH_PreviewArgs args)
  {

    if(flag){
      material.IsTwoSided = true;
      material.BackDiffuse = Color.Red;
    } else {
      material.IsTwoSided = false;
    }

    for(int i = 0; i < display.Count; i++){
      if(display.Count != colors.Count){
        material.Diffuse = Color.FromArgb(255, 255, 255);
        args.Display.DrawMeshShaded(display[i], material);
      }
      else{
        material.Diffuse = colors[i];
        args.Display.DrawMeshShaded(display[i], material);

      }


    }

  }

  //Draw all wires and points in this method.
  public override void DrawViewportWires(IGH_PreviewArgs args)
  {
  }
# ---------- end c_script_2 ----------
