# Grasshopper definition 170228_Weaving2.gh (Grasshopper 0.9.76)
# plug-ins: MeshEdit Components, PolyMesh_Physics, Ninjaroo, horsterCameraControl, Kangaroo Components, Weaverbird, SelectablePreview, Kangaroo2 Components, K2Collisions, PolyMesh_GH

# ---- group: generate
number_slider = Slider(2, range=0..100)
number_slider_2 = Slider(4566568, range=0..100000000)
random = Random(Range=Slider(227753, range=0..1000000), Number=number_slider, Seed=number_slider_2, Integers=True)
random_2 = Random(Range=".4 to .6", Number=number_slider, Seed=number_slider_2)
addition = Addition(A=random, B=random_2)
topobuild = TopologyBuilder(
    Instructions=addition,
    Radius=5,
    Height=Slider(2, range=0..10),
    Collapse=Slider(1, range=0..2),
    Minimal=Slider(10, range=0..100),
    MinOpt=True)  # -> Curves, Values, Faces

# ----
values = Integer(flatten(topobuild.Values))
int = Integer(flatten(topobuild.Faces))

# ---- group: relax
end = EndPoints(Curve=topobuild.Curves)  # -> Start, End
number_slider_3 = Slider(13.334, range=0..100)
cullpt = CullDuplicates(Points=flatten([end.Start, end.End]), Tolerance=0.1, CullMode=3)  # -> Points, Indices, Valence
ln = Line(StartPoint=end.Start, EndPoint=end.End)
length_line = LengthLine(Line=flatten(ln), Length=number_slider_3, Strength=10)
sc = SphereCollide(Points=cullpt.Points, Radius=number_slider_3, Strength=Slider(5.09, range=0..100))
zombiesolver = ZombieSolver(GoalObjects=[length_line, sc], Threshold=1e-10, Tolerance=0.01, MaxIterations=50000)  # -> I, V, O
clean = CleanTree(RemoveNulls=True, RemoveInvalid=True, RemoveEmpty=False, Tree=zombiesolver.O)

# ---- group: orient
eval = EvaluateCurve(Curve=reparameterize(clean), Parameter="0.5")  # -> Point, Tangent, Angle
end_2 = EndPoints(Curve=clean)  # -> Start, End
item = ListItem(List=reverse(end_2.End), Index=0, Wrap=True)
avr = Average(Input=eval.Point)
item_2 = ListItem(List=end_2.Start, Index=0, Wrap=True)
yz = YZPlane(Origin=Point(0, 0, 0))
pl_3pt = Plane3Pt(PointA=item_2, PointB=item, PointC=avr)
orient = Orient(Geometry=clean, Source=pl_3pt, Target=yz)  # -> Geometry, Transform

# ----
lng = ListLength(List=int)
dup = DuplicateData(Data=Slider(30, range=0..100), Number=lng, Order=True)

# ---- group: mesh
wrap = WrapTopology(Lines=orient.Geometry, Values=values, Faces=int, Truncate=Slider(0.2, range=0..1))

# ----
nakede = NakedEdges(PolyMesh=wrap, Manifold=True)
cp = ControlPoints(Curve=nakede)  # -> Points, Weights, Knots
lng_2 = ListLength(List=cp.Points)  # -> flatten(Length)
smooth = Smooth(M=wrap, Strength=Slider(0.95, range=0..10))
floor = Floor(Strength=1)
sort = SortList(Keys=lng_2, ValuesValuesA=nakede)  # -> Keys, reverse(ValuesValuesA)
relax = RelaxPolyMesh(PolyMesh=wrap, Edge=Slider(1, range=0..1), Anchor=Slider(100, range=0..10000), Speed="0.95", Stretch="0.001")
eval_2 = EvaluateCurve(Curve=reparameterize(orient.Geometry), Parameter=Slider(0.5, range=0..1))  # -> Point, Tangent, Angle
pressure = Pressure(M=wrap, Strength=Slider(0, range=0..0.1))
item_3 = ListItem(List=sort.ValuesValuesA, Index=0, Wrap=True)  # -> Item, Item1
tag = TextTag3D(Location=eval_2.Point, Size=1, Justification=7)
number_slider_4 = Slider(10000, range=0..10000)
disc = Discontinuity(Curve=item_3.Item1, Level=1)  # -> Points, Parameters
disc_2 = Discontinuity(Curve=item_3.Item, Level=1)  # -> Points, Parameters
C = Coincident(Point0=disc_2.Points, Point1=disc.Points, Strength=Slider(0, range=0..1))
merge = Merge(Data1=flatten(relax), Data2=flatten(C), Data3=flatten(smooth), Data4=flatten(pressure), Data5=flatten(floor))
ninjaroo = NinjaKangaroo(Goals=merge, Tolerance=0.01, Energy=0, Reset=Button(), Run=Toggle(False), geo=False)  # -> Iterations, Positions, Outputs; disabled

item_4 = ListItem(
    List=[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, "Grasshopper.Kernel.Types.GH_ObjectWrapper", "Grasshopper.Kernel.Types.GH_ObjectWrapper", "Grasshopper.Kernel.Types.GH_ObjectWrapper", "Grasshopper.Kernel.Types.GH_ObjectWrapper", "Grasshopper.Kernel.Types.GH_ObjectWrapper"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],
    Index=0,
    Wrap=True)
getedges = GetEdges(PolyMesh=item_4)  # -> Edges, Naked, Faces
lng_3 = ListLength(List=getedges.Naked)
repeat = RepeatData(Data="2", Length=lng_3)
selpv = SelectablePreview(
    Geometry=getedges.Edges,
    lock=True,
    maintain=False,
    selectedobject="{0;0;0}(1286)|{0;0;0}(1285)|{0;0;0}(273)|{0;0;0}(272)|{0;0;0}(230)|{0;0;0}(229)|{0;0;0}(195)|{0;0;0}(194)|{0;0;0}(176)|{0;0;0}(175)|{0;0;0}(131)|{0;0;0}(130)|{0;0;0}(116)|{0;0;0}(46)|{0;0;0}(3)|{0;0;0}(2)|||||||||")  # -> Geometry, Path, Index
c_script = CSharpScript(x=repeat, y=selpv.Index)  # -> out, A; inputs x: list of Int32, y: list of Int32
# ---------- c_script: C# ----------
    for(int i = 0; i < x.Count; i++)
      if(y.Contains(i))
        x[i] -= 2;

    A = x;
# ---------- end c_script ----------
weaver = Weaver(PolyMesh=item_4, Colors=c_script.A, Depth=Slider(0.079, range=0..10), Type=Slider(1, range=0..10))  # -> simplify(Geometry)

joinweld = JoinWeld(PolyMesh=weaver, Weld=True)  # -> flatten(PolyMesh)
joinweld_2 = JoinWeld(PolyMesh=flatten(weaver), Weld=True)
mesh = Mesh(joinweld_2)
clean_2 = CombineClean(Meshes=mesh)
wbjoin = WeaverbirdsJoinMeshesAndWeld(Mesh=flatten(clean_2), Weld=True)
mesh_2 = Mesh(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)
unifynormals = MeshUnifyNormals(Mesh=mesh_2)
mesh_3 = Mesh(unifynormals)
mesh_4 = Mesh(<mesh referenced from the Rhino model>)
mesh_5 = Mesh(unifynormals)
area = Area(Geometry=unifynormals)  # -> Area, Centroid
Z = UnitZ(Factor=Slider(-0.461, range=-11..25))

values_2 = Values(
    ClothedEdges=Slider(0.8, range=0.001..100),
    NakedEdges=Slider(0.6, range=0.001..100),
    SpringsStrength=Slider(10, range=0.001..100),
    HingeStrength=Slider(10, range=0.001..100),
    CollisionRadius=Slider(0.04, range=0.001..100),
    CollisionStrength=Slider(100, range=0.001..100),
    OffsetSpatialHash=Slider(3, range=0.001..100))
collision_box = CollisionBox(Mesh=mesh_3, Inflate=Slider(1, range=0.1..11.1), BinScale=Slider(1, range=0..1))  # -> BoundingBox, Subdivisions
toggle = BooleanToggle(False)
mesh_6 = Mesh(mesh_5)

timer = Timer(TimerInterval=1, Target=counter)  # disabled
counter = Counter(Reset=False)
division = Division(A=counter, B=1000)
k2_pl_gh = K2Plankton(
    Reset=Button(),
    On=Toggle(True),
    Mesh=mesh_6,
    Values=values_2,
    BoundingBox=collision_box.BoundingBox,
    Subdivisions=collision_box.Subdivisions,
    Threading=False,
    ValenceX4Anchors=Toggle(False))  # -> Mesh, Positions
item_5 = ListItem(List=k2_pl_gh.Positions, Index=0, Wrap=True)  # -> Item1, Item
c_script_2 = CSharpScript(x=item_5.Item1)  # -> out, A
# ---------- c_script_2: C# ----------
    A = x;
# ---------- end c_script_2 ----------
panel = Panel(c_script_2.A)

pt = Point(area.Centroid)
Z_2 = UnitZ(Factor=Slider(-11, range=-11..25))
move = Move(Geometry=pt, Motion=Z_2)  # -> Geometry, Transform
circle = CircleCNR(Center=move.Geometry, Normal=Vector(0, 0, 1), Radius=Slider(51.626, range=0..305))
eval_3 = EvaluateCurve(Curve=reparameterize(circle), Parameter=division)  # -> Point, Tangent, Angle

move_2 = Move(Geometry=pt, Motion=Z)  # -> Geometry, Transform

setcam = SetCamera(CameraLocation=eval_3.Point, TargetLocation=move_2.Geometry, Activate=True)  # disabled
