# Grasshopper definition WeavingOptimize.gh (Grasshopper 0.9.76)
# plug-ins: MeshEdit Components, PolyMesh_Physics, Ninjaroo, Human, horsterCameraControl, Kangaroo Components, PlanktonGh, Weaverbird, SelectablePreview, Kangaroo2 Components, K2Collisions, PolyMesh_GH

# ---- group: generate
number_slider = Slider(2, range=0..100)
number_slider_2 = Slider(4566568, range=0..100000000)
random = Random(Range=Slider(227753, range=0..1000000), Number=number_slider, Seed=number_slider_2, Integers=True)
random_2 = Random(Range=".4 to .6", Number=number_slider, Seed=number_slider_2)
addition = Addition(A=random, B=random_2)
topology_builder = TopologyBuilder(
    Instructions=addition,
    Radius=5,
    Height=Slider(2, range=0..10),
    Collapse=Slider(1, range=0..2),
    Minimal=Slider(10, range=0..100),
    Optimize=True)  # -> Curves, Values, Faces

# ----
values = Integer(flatten(topology_builder.Values))
integer = Integer(flatten(topology_builder.Faces))

# ---- group: relax
end_points = EndPoints(Curve=topology_builder.Curves)  # -> Start, End
cull_duplicates = CullDuplicates(Points=flatten([end_points.Start, end_points.End]), Tolerance=0.1, CullMode=3)  # -> Points, Indices, Valence
number_slider_3 = Slider(13.334, range=0..100)
line = Line(StartPoint=end_points.Start, EndPoint=end_points.End)
length_line = LengthLine(Line=flatten(line), Length=number_slider_3, Strength=10)
spherecollide = SphereCollide(Points=cull_duplicates.Points, Radius=number_slider_3, Strength=Slider(5.09, range=0..100))
zombiesolver = ZombieSolver(GoalObjects=[length_line, spherecollide], Threshold=1e-10, Tolerance=0.01, MaxIterations=50000)  # -> I, V, O
clean_tree = CleanTree(RemoveNulls=True, RemoveInvalid=True, RemoveEmpty=False, Tree=zombiesolver.O)

# ---- group: orient
evaluate_curve = EvaluateCurve(Curve=reparameterize(clean_tree), Parameter="0.5")  # -> Point, Tangent, Angle
end_points_2 = EndPoints(Curve=clean_tree)  # -> Start, End
average = Average(Input=evaluate_curve.Point)
list_item = ListItem(List=reverse(end_points_2.End), Index=0, Wrap=True)
list_item_2 = ListItem(List=end_points_2.Start, Index=0, Wrap=True)
plane_3pt = Plane3Pt(PointA=list_item_2, PointB=list_item, PointC=average)
yz_plane = YZPlane(Origin=Point(0, 0, 0))
orient = Orient(Geometry=clean_tree, Source=plane_3pt, Target=yz_plane)  # -> Geometry, Transform

# ----
list_length = ListLength(List=integer)
duplicate_data = DuplicateData(Data=Slider(30, range=0..100), Number=list_length, Order=True)

# ---- group: mesh
wrap_topology = WrapTopology(Lines=orient.Geometry, Values=values, Faces=integer, Truncate=Slider(0.2, range=0..1))

# ----
naked_edges = NakedEdges(PolyMesh=wrap_topology, Manifold=True)
control_points = ControlPoints(Curve=naked_edges)  # -> Points, Weights, Knots
list_length_2 = ListLength(List=control_points.Points)  # -> flatten(Length)
smooth = Smooth(M=wrap_topology, Strength=Slider(0.95, range=0..10))
sort_list = SortList(Keys=list_length_2, ValuesValuesA=naked_edges)  # -> Keys, reverse(ValuesValuesA)
floor = Floor(Strength=1)
relax_polymesh = RelaxPolyMesh(PolyMesh=wrap_topology, Edge=Slider(1, range=0..1), Anchor=Slider(100, range=0..10000), Speed="0.95", Stretch="0.001")
evaluate_curve_2 = EvaluateCurve(Curve=reparameterize(orient.Geometry), Parameter=Slider(0.5, range=0..1))  # -> Point, Tangent, Angle
pressure = Pressure(M=wrap_topology, Strength=Slider(0, range=0..0.1))
text_tag_3d = TextTag3D(Location=evaluate_curve_2.Point, Size=1, Justification=7)
list_item_3 = ListItem(List=sort_list.ValuesValuesA, Index=0, Wrap=True)  # -> Item, Item1
number_slider_4 = Slider(10000, range=0..10000)
discontinuity = Discontinuity(Curve=list_item_3.Item1, Level=1)  # -> Points, Parameters
discontinuity_2 = Discontinuity(Curve=list_item_3.Item, Level=1)  # -> Points, Parameters
coincident = Coincident(Point0=discontinuity_2.Points, Point1=discontinuity.Points, Strength=Slider(0, range=0..1))
merge = Merge(
    Data1=flatten(relax_polymesh),
    Data2=flatten(coincident),
    Data3=flatten(smooth),
    Data4=flatten(pressure),
    Data5=flatten(floor))
ninja_kangaroo = NinjaKangaroo(Goals=merge, Tolerance=0.01, Energy=0, Reset=Button(), Run=Toggle(False), geo=False)  # -> Iterations, Positions, Outputs; disabled

list_item_4 = ListItem(
    List=[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, "Grasshopper.Kernel.Types.GH_ObjectWrapper", "Grasshopper.Kernel.Types.GH_ObjectWrapper", "Grasshopper.Kernel.Types.GH_ObjectWrapper", "Grasshopper.Kernel.Types.GH_ObjectWrapper", "Grasshopper.Kernel.Types.GH_ObjectWrapper"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],
    Index=0,
    Wrap=True)
get_edges = GetEdges(PolyMesh=list_item_4)  # -> Edges, Naked, Faces
list_length_3 = ListLength(List=get_edges.Naked)
selectablepreview = SelectablePreview(
    Geometry=get_edges.Edges,
    lock=True,
    maintain=False,
    selectedobject="{0;0;0}(1286)|{0;0;0}(1285)|{0;0;0}(273)|{0;0;0}(272)|{0;0;0}(230)|{0;0;0}(229)|{0;0;0}(195)|{0;0;0}(194)|{0;0;0}(176)|{0;0;0}(175)|{0;0;0}(131)|{0;0;0}(130)|{0;0;0}(116)|{0;0;0}(46)|{0;0;0}(3)|{0;0;0}(2)||||||||")  # -> Geometry, Path, Index
repeat_data = RepeatData(Data="2", Length=list_length_3)
c_script = CSharpScript(x=repeat_data, y=selectablepreview.Index)  # -> out, A; inputs x: list of Int32, y: list of Int32
# ---------- c_script: C# ----------
    for(int i = 0; i < x.Count; i++)
      if(y.Contains(i))
        x[i] -= 2;

    A = x;
# ---------- end c_script ----------
weaver = Weaver(PolyMesh=list_item_4, Colors=c_script.A, Depth=Slider(0.079, range=0..10), Type=Slider(1, range=0..10))  # -> simplify(Geometry)

join_weld = JoinWeld(PolyMesh=weaver, Weld=True)  # -> flatten(PolyMesh)
join_weld_2 = JoinWeld(PolyMesh=flatten(weaver), Weld=True)
mesh = Mesh(join_weld_2)
combine_clean = CombineClean(Meshes=mesh)
weaverbird_s_join_meshes_and_weld = WeaverbirdsJoinMeshesAndWeld(Mesh=flatten(combine_clean), Weld=True)
mesh_unifynormals = MeshUnifyNormals(Mesh=weaverbird_s_join_meshes_and_weld)
mesh_2 = Mesh(mesh_unifynormals)
mesh_3 = Mesh(<mesh referenced from the Rhino model>)
area = Area(Geometry=mesh_unifynormals)  # -> Area, Centroid
mesh_4 = Mesh(mesh_unifynormals)
unit_z = UnitZ(Factor=Slider(-0.461, range=-11..25))

button = Button()
boolean_toggle = BooleanToggle(False)
values_2 = Values(
    ClothedEdges=Slider(0.8, range=0.001..100),
    NakedEdges=Slider(0.6, range=0.001..100),
    SpringsStrength=Slider(10, range=0.001..100),
    HingeStrength=Slider(10, range=0.001..100),
    CollisionRadius=Slider(0.04, range=0.001..100),
    CollisionStrength=Slider(100, range=0.001..100),
    OffsetSpatialHash=Slider(3, range=0.001..100))
collision_box = CollisionBox(Mesh=mesh_2, Inflate=Slider(1, range=0.1..11.1), BinScale=Slider(1, range=0..1))  # -> BoundingBox, Subdivisions
boolean_toggle_2 = BooleanToggle(False)
mesh_5 = Mesh(mesh_4)

timer = Timer(TimerInterval=1, Target=counter)  # disabled
counter = Counter(Reset=False)
division = Division(A=counter, B=1000)
mesh_6 = Mesh(<mesh referenced from the Rhino model>)
planktonmesh = PlanktonMesh(mesh_6)
k2_plankton = K2Plankton(
    Reset=button,
    On=boolean_toggle,
    Mesh=mesh_5,
    Values=values_2,
    BoundingBox=collision_box.BoundingBox,
    Subdivisions=collision_box.Subdivisions,
    Threading=False,
    ValenceX4Anchors=boolean_toggle_2)  # -> Mesh, Positions
k2_plankton_2 = K2Plankton(
    Reset=button,
    On=boolean_toggle,
    Mesh=mesh_5,
    Values=values_2,
    BoundingBox=collision_box.BoundingBox,
    Subdivisions=collision_box.Subdivisions,
    Threading=Toggle(False),
    ValenceX4Anchors=boolean_toggle_2)  # disabled
c_script_2 = CSharpScript(
    x=mesh_6,
    Reference=["C:\Users\pves\AppData\Roaming\Grasshopper\Libraries\Kangaroo2\Plankton.dll", "C:\Users\pves\AppData\Roaming\Grasshopper\Libraries\Kangaroo2\PlanktonGh.dll"])  # -> out, A, B, C, D, E1, E2, E3, E4, E; inputs x: Mesh
# ---------- c_script_2: C# ----------
    mesh = x;

    Init();
    A = pm;
    B = ce;
    C = v;




    List<Line> lines = new List<Line>();
    


    int count = 0;
    for (int i = 0; i < ce.BranchCount; i++)
    {

      for (int j = 0; j < ce.Branch(i).Count; j++)
      {
        int s = pm[i].Halfedges[ce.Branch(i)[j]].StartVertex; //Start index in nested array
        int e = pm[i].Halfedges[ce.Branch(i)[j] + 1].StartVertex;//End index in nested array
        double dist = pm[i].Halfedges.GetLength(ce.Branch(i)[j]);

        lines.Add(new Line(points[count + s], points[count + e]));
      }
      count += pm[i].Vertices.Count;
    }

    D = lines;

    hingeGoals();
    
    
    List<int> sss = new List<int>();    
    
    for (int i = 0; i < pm.Length; i++)
    {
      for(int j = 0; j < pm[i].Vertices.Count; j++){
        sss.Add(pm[i].Vertices.GetHalfedges(j).Length);
      }
    }
    
    E = sss;

    E1 = IEdgeEnd1;
    E2 = IEdgeEnd2;
    E3 = ITip1;
    E4 = ITip2;
# ---------- c_script_2: C# additional code ----------
  //Kangaroo

  List<double> goalValues = new List<double>();
  bool anchors = false;

  //Meshes
  Mesh mesh; //Input mesh is joined clean mesh
  PlanktonMesh[] pm; //Input mesh is disjoint into array of meshes
  DataTree<int> ne = new DataTree<int>();
  DataTree<int> ce = new DataTree<int>();
  DataTree<int> v = new DataTree<int>();
  List<Point3d> points = new List<Point3d>();

  //Hinges
  //Topology vertex indices
  int[] IEdgeEnd1;
  int[] IEdgeEnd2;
  int[] ITip1;
  int[] ITip2;

  //SpatialGrid

  private int NCollisions;


  //Animation
  bool Threading;
  bool Running;
  //double VSum;

  public void Init(){
    //Disjoint meshes
    Mesh[] tempMeshes = mesh.SplitDisjointPieces();
    pm = new PlanktonMesh[tempMeshes.Length];

    //Naked edges and vertives
    ne = new DataTree<int>();
    ce = new DataTree<int>();
    v = new DataTree<int>();




    for (int i = 0; i < pm.Length; i++)
    {
      //Convert to pm
      pm[i] = tempMeshes[i].ToPlanktonMesh();

      //Naked edges
      for (int j = 0; j < pm[i].Halfedges.Count; j += 2)
        if (pm[i].Halfedges.IsBoundary(j))
          ne.Add(j, new GH_Path(i));
        else
          ce.Add(j, new GH_Path(i));


      //Vertices
      for (int j = 0; j < pm[i].Vertices.Count; j++)
      {
        points.Add(pm[i].Vertices[j].ToPoint3d());
        v.Add(j, new GH_Path(i));
      }
    }

  }




  private void springGoals()
  {
    //Check in Rhino

    int count = 0;
    for (int i = 0; i < ce.BranchCount; i++)
    {
      for (int j = 0; j < ce.Branch(i).Count; j++)
      {
        int s = pm[i].Halfedges[ce.Branch(i)[j]].StartVertex;
        int e = pm[i].Halfedges[ce.Branch(i)[j] + 1].StartVertex;

        double dist = pm[i].Halfedges.GetLength(ce.Branch(i)[0]);

        //  goals.Add(new SpringGrow(count + s, count + e, dist, goalValues[0], goalValues[2]));

      }
      count += pm[i].Vertices.Count;
    }

  }



  private void hingeGoals()
  {

    IEdgeEnd1 = new int[ce.AllData().Count];
    IEdgeEnd2 = new int[ce.AllData().Count];
    ITip1 = new int[ce.AllData().Count];
    ITip2 = new int[ce.AllData().Count];


    int count = 0;
    int n = 0;



    for (int i = 0; i < pm.Length; i++) {
      for (int j = 0; j < ce.Branch(i).Count; j++) {
        IEdgeEnd1[n] = pm[i].Halfedges[ce.Branch(i)[j]].StartVertex + count;
        IEdgeEnd2[n] = pm[i].Halfedges[ce.Branch(i)[j] + 1].StartVertex + count;
        int prev1 = pm[i].Halfedges[ce.Branch(i)[j]].PrevHalfedge;
        int prev2 = pm[i].Halfedges[ce.Branch(i)[j] + 1].PrevHalfedge;

        ITip1[n] = pm[i].Halfedges[prev1].StartVertex + count;
        ITip2[n] = pm[i].Halfedges[prev2].StartVertex + count;
        n++;
      }
      count += pm[i].Vertices.Count;
    }

    //goals.Add(new HingeAll(IEdgeEnd1, IEdgeEnd2, ITip1, ITip2, 0, goalValues[3]));

  }
# ---------- end c_script_2 ----------
planktonmesh_2 = PlanktonMesh(k2_plankton.Mesh)
text_length = TextLength(Text=k2_plankton.Positions)
planktonmesh_3 = PlanktonMesh(c_script_2.A)
merge_2 = Merge(Data1=graft(c_script_2.E1), Data2=graft(c_script_2.E2), Data3=graft(c_script_2.E3), Data4=graft(c_script_2.E4))
c_script_3 = CSharpScript(
    x=planktonmesh_3,
    Reference=["C:\Users\pves\AppData\Roaming\Grasshopper\Libraries\Kangaroo2\Plankton.dll", "C:\Users\pves\AppData\Roaming\Grasshopper\Libraries\Kangaroo2\PlanktonGh.dll"])  # -> out, A
# ---------- c_script_3: C# ----------
    PlanktonMesh pm = (PlanktonMesh) (x);

    List<Point3d> p = new List<Point3d>();

    for(int i = 0; i < pm.Vertices.Count; i++){
      p.Add(pm.Vertices[i].ToPoint3d());
    }

    A = p;
# ---------- end c_script_3 ----------
text_fragment = TextFragment(Text=k2_plankton.Positions, Start=1, Count=expr("x-2", text_length))
point = Point(flatten(c_script_3.A))
point_2 = Point(text_fragment)
tree_branch = TreeBranch(Tree=simplify(merge_2), Path=Slider(97, range=0..100), MaintainPaths=True)
panel = Panel(c_script_2.E4)
list_item_5 = ListItem(List=point, Index=tree_branch, Wrap=True)
list_item_6 = ListItem(List=list_item_5, Index=0, Wrap=True)  # -> Item, Item1, Item2, Item3
sphere = Sphere(Base=[list_item_6.Item2, list_item_6.Item3], Radius=Slider(0.015, range=0..1))
line_2 = Line(StartPoint=list_item_6.Item, EndPoint=list_item_6.Item1)
custom_preview = CustomPreview(
    Geometry=sphere,
    Shader={ambient=RGB(0, 0, 0), diffuse=RGB(255, 105, 180), emission=RGB(76, 32, 54), shine=0.5, specular=RGB(255, 255, 255), transparency=0})
panel_2 = Panel(list_item_6.Item)
custom_preview_lineweights = CustomPreviewLineweights(Geometry=line_2, Shader=ColourSwatch(SwatchColor=RGB(255, 0, 255)), Thickness=Slider(4, range=0..10), Absolute=False)

unit_z_2 = UnitZ(Factor=Slider(-11, range=-11..25))
point_3 = Point(area.Centroid)
move = Move(Geometry=point_3, Motion=unit_z_2)  # -> Geometry, Transform
circle_cnr = CircleCNR(Center=move.Geometry, Normal=Vector(0, 0, 1), Radius=Slider(51.626, range=0..305))
evaluate_curve_3 = EvaluateCurve(Curve=reparameterize(circle_cnr), Parameter=division)  # -> Point, Tangent, Angle

move_2 = Move(Geometry=point_3, Motion=unit_z)  # -> Geometry, Transform

set_camera = SetCamera(CameraLocation=evaluate_curve_3.Point, TargetLocation=move_2.Geometry, Activate=True)  # disabled
