# Grasshopper definition Weaver_Graph.gh (Grasshopper 0.9.76)
# plug-ins: MeshEdit Components, PolyMesh_Physics, Ninjaroo, horsterCameraControl, Kangaroo Components, PlanktonGh, Weaverbird, Kangaroo2 Components, K2Collisions, PolyMesh_GH

# ---- group: generate
number_slider = Slider(2, range=0..100)
number_slider_2 = Slider(4566568, range=0..100000000)
random = Random(Range=Slider(227753, range=0..1000000), Number=number_slider, Seed=number_slider_2, Integers=True)
random_2 = Random(Range=".4 to .6", Number=number_slider, Seed=number_slider_2)
addition = Addition(A=random, B=random_2)
topobuild = TopologyBuilder(
    Instructions=addition,
    Radius=5,
    Height=Slider(2, range=0..10),
    Collapse=Slider(1, range=0..2),
    Minimal=Slider(10, range=0..100),
    MinOpt=True)  # -> Curves, Values, Faces

# ----
values = Integer(flatten(topobuild.Values))
int = Integer(flatten(topobuild.Faces))

# ---- group: relax
end = EndPoints(Curve=topobuild.Curves)  # -> Start, End
number_slider_3 = Slider(13.334, range=0..100)
cullpt = CullDuplicates(Points=flatten([end.Start, end.End]), Tolerance=0.1, CullMode=3)  # -> Points, Indices, Valence
ln = Line(StartPoint=end.Start, EndPoint=end.End)
length_line = LengthLine(Line=flatten(ln), Length=number_slider_3, Strength=10)
sc = SphereCollide(Points=cullpt.Points, Radius=number_slider_3, Strength=Slider(5.09, range=0..100))
zombiesolver = ZombieSolver(GoalObjects=[length_line, sc], Threshold=1e-10, Tolerance=0.01, MaxIterations=50000)  # -> I, V, O
clean = CleanTree(RemoveNulls=True, RemoveInvalid=True, RemoveEmpty=False, Tree=zombiesolver.O)

# ---- group: orient
eval = EvaluateCurve(Curve=reparameterize(clean), Parameter="0.5")  # -> Point, Tangent, Angle
end_2 = EndPoints(Curve=clean)  # -> Start, End
item = ListItem(List=reverse(end_2.End), Index=0, Wrap=True)
avr = Average(Input=eval.Point)
item_2 = ListItem(List=end_2.Start, Index=0, Wrap=True)
yz = YZPlane(Origin=Point(0, 0, 0))
pl_3pt = Plane3Pt(PointA=item_2, PointB=item, PointC=avr)
orient = Orient(Geometry=clean, Source=pl_3pt, Target=yz)  # -> Geometry, Transform

# ----
lng = ListLength(List=int)
dup = DuplicateData(Data=Slider(30, range=0..100), Number=lng, Order=True)

# ---- group: mesh
wrap = WrapTopology(Lines=orient.Geometry, Values=values, Faces=int, Truncate=Slider(0.2, range=0..1))

# ----
nakede = NakedEdges(PolyMesh=wrap, Manifold=True)
cp = ControlPoints(Curve=nakede)  # -> Points, Weights, Knots
lng_2 = ListLength(List=cp.Points)  # -> flatten(Length)
smooth = Smooth(M=wrap, Strength=Slider(0.95, range=0..10))
floor = Floor(Strength=1)
sort = SortList(Keys=lng_2, ValuesA=nakede)  # -> Keys, reverse(ValuesA)
relax = RelaxPolyMesh(PolyMesh=wrap, Edge=Slider(1, range=0..1), Anchor=Slider(100, range=0..10000), Speed="0.95", Stretch="0.001")
eval_2 = EvaluateCurve(Curve=reparameterize(orient.Geometry), Parameter=Slider(0.5, range=0..1))  # -> Point, Tangent, Angle
pressure = Pressure(M=wrap, Strength=Slider(0, range=0..0.1))
item_3 = ListItem(List=sort.ValuesA, Index=0, Wrap=True)  # -> Item, Item1
tag = TextTag3D(Location=eval_2.Point, Size=1, Justification=7)
number_slider_4 = Slider(10000, range=0..10000)
disc = Discontinuity(Curve=item_3.Item1, Level=1)  # -> Points, Parameters
disc_2 = Discontinuity(Curve=item_3.Item, Level=1)  # -> Points, Parameters
C = Coincident(Point0=disc_2.Points, Point1=disc.Points, Strength=Slider(0, range=0..1))
merge = Merge(Data1=flatten(relax), Data2=flatten(C), Data3=flatten(smooth), Data4=flatten(pressure), Data5=flatten(floor))
ninjaroo = NinjaKangaroo(Goals=merge, Tolerance=0.01, Energy=0, Reset=Button(), Run=Toggle(False), geo=False)  # -> Iterations, Positions, Outputs; disabled
number_slider_5 = Slider(2, range=0..10)
item_4 = ListItem(
    List=[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, "Grasshopper.Kernel.Types.GH_ObjectWrapper", "Grasshopper.Kernel.Types.GH_ObjectWrapper", "Grasshopper.Kernel.Types.GH_ObjectWrapper", "Grasshopper.Kernel.Types.GH_ObjectWrapper", "Grasshopper.Kernel.Types.GH_ObjectWrapper"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],
    Index=0,
    Wrap=True)
getedges = GetEdges(PolyMesh=item_4)  # -> Edges, Naked, Faces
item_5 = ListItem(List=["2", "0"], Index=getedges.Naked, Wrap=True)
lng_3 = ListLength(List=getedges.Edges)
dup_2 = DuplicateData(Data="2", Number=lng_3, Order=True)
weaver = Weaver(PolyMesh=item_4, Colors=item_5, Depth=Slider(0.079, range=0..10), Type=Slider(1, range=0..10))
joinweld = JoinWeld(PolyMesh=flatten(weaver), Weld=True)
mesh = Mesh(joinweld)
clean_2 = CombineClean(Meshes=mesh)
wbjoin = WeaverbirdsJoinMeshesAndWeld(Mesh=flatten(clean_2), Weld=True)
unifynormals = MeshUnifyNormals(Mesh=wbjoin)
mesh_2 = Mesh(unifynormals)
mesh_3 = Mesh(unifynormals)
area = Area(Geometry=unifynormals)  # -> Area, Centroid
Z = UnitZ(Factor=Slider(-0.461, range=-11..25))

button = Button()
toggle = BooleanToggle(False)
values_2 = Values(
    ClothedEdges=Slider(0.9, range=0.001..100),
    NakedEdges=Slider(0.7, range=0.001..100),
    SpringsStrength=Slider(10, range=0.001..100),
    HingeStrength=Slider(10, range=0.001..100),
    CollisionRadius=Slider(0.04, range=0.001..100),
    CollisionStrength=Slider(100, range=0.001..100),
    OffsetSpatialHash=Slider(10, range=0.001..100))
collision_box = CollisionBox(Mesh=mesh_2, Inflate=Slider(1, range=0.1..11.1), BinScale=Slider(1, range=0..1))  # -> BoundingBox, Subdivisions
mesh_4 = Mesh(mesh_3)

timer = Timer(TimerInterval=1, Target=counter)  # disabled
counter = Counter(Reset=False)
division = Division(A=counter, B=1000)
k2_pl_gh = K2Plankton(
    Reset=button,
    On=toggle,
    Mesh=mesh_4,
    Values=values_2,
    BoundingBox=collision_box.BoundingBox,
    Subdivisions=collision_box.Subdivisions,
    Threading=False,
    ValenceX4Anchors=False)
k2_pl = K2Plankton(
    Reset=button,
    On=toggle,
    Mesh=mesh_4,
    Values=values_2,
    BoundingBox=collision_box.BoundingBox,
    Subdivisions=collision_box.Subdivisions,
    Threading=Toggle(False),
    ValenceX4Anchors=Toggle(True))  # disabled
c_script = CSharpScript(
    x=mesh_3,
    Reference=["C:\Users\pves\AppData\Roaming\Grasshopper\Libraries\Kangaroo2\Plankton.dll", "C:\Users\pves\AppData\Roaming\Grasshopper\Libraries\Kangaroo2\PlanktonGh.dll"])  # -> out, A, B, C, D; inputs x: Mesh; disabled
# ---------- c_script: C# ----------
    mesh = x;

    Init();
    A = pm;
    B = ce;
    C = v;




    List<Line> lines = new List<Line>();
    List<int> sss = new List<int>();


    int count = 0;
    for (int i = 0; i < ce.BranchCount; i++)
    {
      for (int j = 0; j < ce.Branch(i).Count; j++)
      {
        int s = pm[i].Halfedges[ce.Branch(i)[j]].StartVertex; //Start index in nested array
        int e = pm[i].Halfedges[ce.Branch(i)[j] + 1].StartVertex;//End index in nested array
        double dist = pm[i].Halfedges.GetLength(ce.Branch(i)[j]);

        lines.Add(new Line(points[count + s], points[count + e]));
      }
      count += pm[i].Vertices.Count;
    }

    D = lines;
# ---------- c_script: C# additional code ----------
  //Kangaroo

  List<double> goalValues = new List<double>();
  bool anchors = false;

  //Meshes
  Mesh mesh; //Input mesh is joined clean mesh
  PlanktonMesh[] pm; //Input mesh is disjoint into array of meshes
  DataTree<int> ne = new DataTree<int>();
  DataTree<int> ce = new DataTree<int>();
  DataTree<int> v = new DataTree<int>();
  List<Point3d> points = new List<Point3d>();

  //SpatialGrid

  private int NCollisions;


  //Animation
  bool Threading;
  bool Running;
  //double VSum;

  public void Init(){
    //Disjoint meshes
    Mesh[] tempMeshes = mesh.SplitDisjointPieces();
    pm = new PlanktonMesh[tempMeshes.Length];

    //Naked edges and vertives
    ne = new DataTree<int>();
    ce = new DataTree<int>();
    v = new DataTree<int>();




    for (int i = 0; i < pm.Length; i++)
    {
      //Convert to pm
      pm[i] = tempMeshes[i].ToPlanktonMesh();

      //Naked edges
      for (int j = 0; j < pm[i].Halfedges.Count; j += 2)
        if (pm[i].Halfedges.IsBoundary(j))
          ne.Add(j, new GH_Path(i));
        else
          ce.Add(j, new GH_Path(i));


      //Vertices
      for (int j = 0; j < pm[i].Vertices.Count; j++)
      {
        points.Add(pm[i].Vertices[j].ToPoint3d());
        v.Add(j, new GH_Path(i));
      }
    }

  }




  private void springGoals()
  {
    //Check in Rhino

    int count = 0;
    for (int i = 0; i < ce.BranchCount; i++)
    {
      for (int j = 0; j < ce.Branch(i).Count; j++)
      {
        int s = pm[i].Halfedges[ce.Branch(i)[0]].StartVertex;
        int e = pm[i].Halfedges[ce.Branch(i)[0] + 1].StartVertex;

        double dist = pm[i].Halfedges.GetLength(ce.Branch(i)[0]);

        //  goals.Add(new SpringGrow(count + s, count + e, dist, goalValues[0], goalValues[2]));

      }
      count += pm[i].Vertices.Count;
    }



  }
# ---------- end c_script ----------
pmesh = PlanktonMesh(k2_pl_gh)
crv = Curve(c_script.D)  # disabled
pmesh_2 = PlanktonMesh(c_script.A)  # disabled
c_script_2 = CSharpScript(
    x=pmesh_2,
    Reference=["C:\Users\pves\AppData\Roaming\Grasshopper\Libraries\Kangaroo2\Plankton.dll", "C:\Users\pves\AppData\Roaming\Grasshopper\Libraries\Kangaroo2\PlanktonGh.dll"])  # -> out, A; disabled
# ---------- c_script_2: C# ----------
    PlanktonMesh pm = (PlanktonMesh) (x);

    List<Point3d> p = new List<Point3d>();

    for(int i = 0; i < pm.Vertices.Count; i++){
      p.Add(pm.Vertices[i].ToPoint3d());
    }

    A = p;
# ---------- end c_script_2 ----------
panel = Panel(c_script.D)
panel_2 = Panel(c_script_2.A)
panel_3 = Panel(c_script.B)

pt = Point(area.Centroid)
Z_2 = UnitZ(Factor=Slider(-11, range=-11..25))
move = Move(Geometry=pt, Motion=Z_2)  # -> Geometry, Transform
circle = CircleCNR(Center=move.Geometry, Normal=Vector(0, 0, 1), Radius=Slider(51.626, range=0..305))
eval_3 = EvaluateCurve(Curve=reparameterize(circle), Parameter=division)  # -> Point, Tangent, Angle

move_2 = Move(Geometry=pt, Motion=Z)  # -> Geometry, Transform

setcam = SetCamera(CameraLocation=eval_3.Point, TargetLocation=move_2.Geometry, Activate=True)
