# Grasshopper definition Weavergh.gh (Grasshopper 0.9.76)
# plug-ins: Kangaroo Components, LunchBox, Weaverbird, K2Collisions, PolyMesh_GH

cluster = Cluster(rad=Slider(11.3, range=0..20), D=Slider(-2.1, range=-2.1..1), F=Slider(0.89, range=0..1))
strips = RefineStrips(Mesh=cluster, Level=Slider(2, range=0..10))  # -> flatten(Mesh)
mjoin = MeshJoin(Meshes=flatten(strips))  # -> flatten(Mesh)
wbjoin = WeaverbirdsJoinMeshesAndWeld(Mesh=mjoin, Weld=False)
wbunify = WeaverbirdsUnifyFaceWindings(MeshCurves=wbjoin)
faceb = FaceBoundaries(Mesh=wbunify)
frompl = FromPolylines(Polylines=faceb)
getedges = GetEdges(PolyMesh=frompl)  # -> Edges, Naked
lng = ListLength(List=getedges.Edges)
repeat = RepeatData(Data="2", Length=lng)
weaver = Weaver(PolyMesh=frompl, Colors=repeat, Depth=0.1, Triangle=Slider(0.7, range=0..1), Type=Slider(1, range=0..1))  # -> simplify(Geometry), simplify(Connections)

platoocta = PlatonicOctahedron(Plane=PlaneXY(0, 0, 0), Radius=10, Truncation=0)
smesh = SimpleMesh(Brep=platoocta)
wbcatmullclark = WeaverbirdsCatmullClarkSubdivision(MeshCurves=smesh, Level=Slider(1, range=0..10), SmoothNakedEdges=1)
mesh = Mesh(wbcatmullclark)
faceb_2 = FaceBoundaries(Mesh=mesh)
frompl_2 = FromPolylines(Polylines=faceb_2)
getedges_2 = GetEdges(PolyMesh=frompl_2)  # -> Edges, Naked
lng_2 = ListLength(List=getedges_2.Edges)
repeat_2 = RepeatData(Data="1", Length=lng_2)
weaver_2 = Weaver(PolyMesh=frompl_2, Colors=repeat_2, Depth=0.1, Triangle=Slider(0.7, range=0..1), Type=Slider(1, range=0..1))  # -> simplify(Geometry), simplify(Connections)

weaver_3 = Weaver(PolyMesh=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, Colors=[1, 1, 1, 1, 1, 1, 1, 1, 1, 1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], Depth=0.1, Triangle=0.7, Type=0)  # -> simplify(Geometry), simplify(Connections)
c_script = CSharpScript(x=weaver_3.Geometry, Reference="C:\Users\pves\AppData\Roaming\Grasshopper\Libraries\CITA\mzwi\PolyMesh_Core.dll")  # -> out, A
# ---------- c_script: C# ----------
    PolyMesh pMesh = (PolyMesh) x;
    A = pMesh.Vertices.ToPoint3d();
# ---------- end c_script ----------
panel = Panel("""2
2
3
3
13
12
13
12
5
4
5
4
10
10
11
11""")
panel_2 = Panel("""21
20
21
20
18
18
19
19
26
26
27
27
28
29
28
29""")
mjoin_2 = MeshJoin(Meshes=flatten(weaver_3.Geometry))
item = ListItem(List=c_script.A, Index=panel, Wrap=True)
item_2 = ListItem(List=c_script.A, Index=panel_2, Wrap=True)
ln = Line(StartPoint=item, EndPoint=item_2)

joinweld = JoinWeld(PolyMesh=flatten(weaver.Geometry), Weld=True)
wbjoin_2 = WeaverbirdsJoinMeshesAndWeld(Mesh=flatten(joinweld), Weld=False)
wbunify_2 = WeaverbirdsUnifyFaceWindings(MeshCurves=wbjoin_2)
mesh_2 = Mesh(wbunify_2)
mesh_3 = Mesh(wbunify_2)

values = Values(
    ClothedEdges=Slider(0.8, range=0.001..100),
    NakedEdges=Slider(0.4, range=0.001..100),
    SpringsStrength=Slider(10, range=0.001..100),
    HingeStrength=Slider(10, range=0.001..100),
    CollisionRadius=Slider(0.05, range=0.001..100),
    CollisionStrength=Slider(100, range=0.001..100),
    OffsetSpatialHash=Slider(1, range=0.001..100))
collision_box = CollisionBox(Mesh=mesh_2, Inflate=Slider(1, range=0.1..11.1), BinScale=Slider(1, range=0..1))  # -> BoundingBox, Subdivisions
mesh_4 = Mesh(mesh_3)

k2_pl = K2Plankton(
    Reset=Button(),
    On=Toggle(False),
    Mesh=mesh_4,
    Values=values,
    BoundingBox=collision_box.BoundingBox,
    Subdivisions=collision_box.Subdivisions,
    Threading=Toggle(False),
    ValenceX4Anchors=Toggle(True))

# ==== cluster Cluster
rad = ClusterInput()
platododec = PlatonicDodecahedron(Plane=PlaneXY(0, 0, 0), Radius=rad)
F = ClusterInput()
area = Area(Geometry=platododec)  # -> Area, Centroid
scale = Scale(Geometry=platododec, Center=area.Centroid, Factor=F)  # -> Geometry, Transform
debrep = DeconstructBrep(Brep=platododec)  # -> Faces, Edges, Vertices
debrep_2 = DeconstructBrep(Brep=scale.Geometry)  # -> Faces, Edges, Vertices
wires = BrepWireframe(Brep=debrep.Faces, Density=-1)
wires_2 = BrepWireframe(Brep=debrep_2.Faces, Density=-1)
D = ClusterInput()
join = JoinCurves(Curves=wires, Preserve=False)
join_2 = JoinCurves(Curves=wires_2, Preserve=False)
offset_l = OffsetLoose(Curve=join, Distance=D)
offset_l_2 = OffsetLoose(Curve=join_2, Distance=D)
explode = Explode(Curve=join, Recursive=True)  # -> graft(Segments), Vertices
explode_2 = Explode(Curve=offset_l_2, Recursive=True)  # -> graft(Segments), Vertices
explode_3 = Explode(Curve=offset_l, Recursive=True)  # -> graft(Segments), Vertices
explode_4 = Explode(Curve=join_2, Recursive=True)  # -> graft(Segments), Vertices
loft = Loft(
    Curves=[explode_3.Segments, explode.Segments],
    Options={Adjust=False, Closed=False, LoftEnds=0, LoftSimp=0, LoftType=0, Rebuild=10, Refit=0.01})
loft_2 = Loft(
    Curves=[explode_3.Segments, explode_2.Segments],
    Options={Adjust=False, Closed=False, LoftEnds=0, LoftSimp=0, LoftType=0, Rebuild=10, Refit=0.01})
loft_3 = Loft(
    Curves=[explode_2.Segments, explode_4.Segments],
    Options={Adjust=False, Closed=False, LoftEnds=0, LoftSimp=0, LoftType=0, Rebuild=10, Refit=0.01})
smesh = SimpleMesh(Brep=[loft, loft_2, loft_3])
M = ClusterOutput(smesh)
