# Grasshopper definition Weavergh02_Ngon2.gh (Grasshopper 0.9.76)
# plug-ins: MeshEdit Components, horsterCameraControl, Kangaroo Components, LunchBox, Weaverbird, SelectablePreview, K2Collisions, PolyMesh_GH

cluster = Cluster(rad=Slider(11.3, range=0..20), D=Slider(-1.9, range=-2.1..1), F=Slider(0.84, range=0..1))
strips = RefineStrips(Mesh=cluster, Level=Slider(2, range=0..10))  # -> flatten(Mesh)
mjoin = MeshJoin(Meshes=flatten(strips))  # -> flatten(Mesh)
wbjoin = WeaverbirdsJoinMeshesAndWeld(Mesh=mjoin, Weld=False)
wbunify = WeaverbirdsUnifyFaceWindings(MeshCurves=wbjoin)
faceb = FaceBoundaries(Mesh=wbunify)
frompl = FromPolylines(Polylines=faceb)
getedges = GetEdges(PolyMesh=frompl)  # -> Edges, Naked
selpv = SelectablePreview(Geometry=getedges.Edges, lock=True, maintain=False, selectedobject="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")  # -> Geometry, Path, Index
lng = ListLength(List=getedges.Edges)
repeat = RepeatData(Data="2", Length=lng)
c_script = CSharpScript(x=repeat, y=selpv.Index)  # -> out, A; inputs x: list of Int32, y: list of Int32
# ---------- c_script: C# ----------
    for(int i = 0; i < x.Count; i++)
      if(y.Contains(i))
        x[i]--;
    
    A = x;
# ---------- end c_script ----------
c_script_2 = CSharpScript(x=c_script.A)  # -> out, A; inputs x: list of Int32, y: list of Int32
# ---------- c_script_2: C# ----------
    for(int i = 0; i < x.Count; i++)
      if(y.Contains(i))
        x[i]=0;

    A = x;
# ---------- end c_script_2 ----------
weaver = Weaver(PolyMesh=frompl, Colors=c_script.A, Depth=0.1, Triangle=Slider(0.7, range=0..1), Type=Slider(1, range=0..1))  # -> simplify(Geometry), simplify(Connections)

platoocta = PlatonicOctahedron(Plane=PlaneXY(0, 0, 0), Radius=10, Truncation=0)
smesh = SimpleMesh(Brep=platoocta)
wbcatmullclark = WeaverbirdsCatmullClarkSubdivision(MeshCurves=smesh, Level=Slider(1, range=0..10), SmoothNakedEdges=1)
mesh = Mesh(wbcatmullclark)
faceb_2 = FaceBoundaries(Mesh=mesh)
frompl_2 = FromPolylines(Polylines=faceb_2)
getedges_2 = GetEdges(PolyMesh=frompl_2)  # -> Edges, Naked
lng_2 = ListLength(List=getedges_2.Edges)
repeat_2 = RepeatData(Data="1", Length=lng_2)
weaver_2 = Weaver(PolyMesh=frompl_2, Colors=repeat_2, Depth=0.1, Triangle=Slider(0.7, range=0..1), Type=Slider(1, range=0..1))  # -> simplify(Geometry), simplify(Connections)

weaver_3 = Weaver(PolyMesh=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, Colors=[1, 1, 1, 1, 1, 1, 1, 1, 1, 1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], Depth=0.1, Triangle=0.7, Type=0)  # -> simplify(Geometry), simplify(Connections)
c_script_3 = CSharpScript(x=weaver_3.Geometry, Reference="C:\Users\pves\AppData\Roaming\Grasshopper\Libraries\CITA\mzwi\PolyMesh_Core.dll")  # -> out, A
# ---------- c_script_3: C# ----------
    PolyMesh pMesh = (PolyMesh) x;
    A = pMesh.Vertices.ToPoint3d();
# ---------- end c_script_3 ----------
panel = Panel("""2
2
3
3
13
12
13
12
5
4
5
4
10
10
11
11""")
panel_2 = Panel("""21
20
21
20
18
18
19
19
26
26
27
27
28
29
28
29""")
mjoin_2 = MeshJoin(Meshes=flatten(weaver_3.Geometry))
item = ListItem(List=c_script_3.A, Index=panel, Wrap=True)
item_2 = ListItem(List=c_script_3.A, Index=panel_2, Wrap=True)
ln = Line(StartPoint=item, EndPoint=item_2)

merge = Merge(
    Data1=ColourSwatch(SwatchColor=RGB(125, 209, 167)),
    Data2=ColourSwatch(SwatchColor=RGB(125, 211, 245)),
    Data3=ColourSwatch(SwatchColor=RGB(250, 247, 152)))
item_3 = ListItem(List=merge, Index=c_script.A, Wrap=True)  # -> flatten(Item)
vb = VBScript(x=frompl, y=item_3, Reference="C:\Users\pves\AppData\Roaming\Grasshopper\Libraries\CITA\mzwi\PolyMesh_Core.dll")  # -> out, A; inputs y: list of Color
# ---------- vb: VB ----------
    Dim pm As polymesh = x

    Dim eds As list(Of topologyedge) = pm.GetTopologyEdges()

    Dim cen() As Point3d = pm.Faces.GetCenters

    Dim ml As New list(Of Mesh)

    For i As Integer = 0 To eds.count - 1 Step 1

      Dim thiscol As Color = y(i)
      Dim thise As topologyedge = eds(i)

      If thise.LeftFace <> -1 Then
        Dim thiscen As Point3d = cen(thise.LeftFace)

        Dim nm As New mesh
        nm.Vertices.Add(thiscen)
        nm.Vertices.Add(pm.Vertices(thise.From))
        nm.Vertices.Add(pm.Vertices(thise.To))
        nm.Faces.AddFace(0, 1, 2)
        nm.VertexColors.Add(thiscol)
        nm.VertexColors.Add(thiscol)
        nm.VertexColors.Add(thiscol)

        ml.add(nm)
      End If

      If thise.RightFace <> -1 Then
        Dim thiscen As Point3d = cen(thise.RightFace)

        Dim nm As New mesh
        nm.Vertices.Add(thiscen)
        nm.Vertices.Add(pm.Vertices(thise.To))
        nm.Vertices.Add(pm.Vertices(thise.From))
        nm.Faces.AddFace(0, 1, 2)
        nm.VertexColors.Add(thiscol)
        nm.VertexColors.Add(thiscol)
        nm.VertexColors.Add(thiscol)

        ml.add(nm)

      End If


    Next


    a = ml
# ---------- end vb ----------
X = UnitX(Factor=Slider(-25, range=-100..100))
medges = MeshEdges(Mesh=vb.A)  # -> NakedEdges, InteriorEdges, NonManifoldEdges
move = Move(Geometry=medges.NakedEdges, Motion=X)  # -> Geometry, Transform
move_2 = Move(Geometry=vb.A, Motion=X)  # -> Geometry, Transform

joinweld = JoinWeld(PolyMesh=flatten(weaver.Geometry), Weld=True)
clean = CombineClean(Meshes=joinweld)
wbjoin_2 = WeaverbirdsJoinMeshesAndWeld(Mesh=flatten(clean), Weld=True)
unifynormals = MeshUnifyNormals(Mesh=wbjoin_2)
mesh_2 = Mesh(unifynormals)
c_script_4 = CSharpScript(x=unifynormals)  # inputs x: Mesh
# ---------- c_script_4: C# ----------
    mesh = x;
    mesh.Normals.ComputeNormals();
# ---------- c_script_4: C# additional code ----------
  Mesh mesh = new Mesh();

  //Return a BoundingBox that contains all the geometry you are about to draw.
  public override BoundingBox ClippingBox
  {
    get
    {
      return mesh.GetBoundingBox(true);
    }
  }

  //Draw all meshes in this method.
  public override void DrawViewportMeshes(IGH_PreviewArgs args)
  {
    var material = new Rhino.Display.DisplayMaterial(Color.FromArgb(255, 255, 255));
    material.IsTwoSided = true;
    material.BackDiffuse = Color.Red;

    if (mesh != null)
      args.Display.DrawMeshShaded(mesh, material);
  }

  //Draw all wires and points in this method.
  public override void DrawViewportWires(IGH_PreviewArgs args)
  {
  }
# ---------- end c_script_4 ----------
mesh_3 = Mesh(mesh_2)
area = Area(Geometry=wbjoin)  # -> Area, Centroid
mesh_4 = Mesh(mesh_2)
mesh_5 = Mesh(<mesh referenced from the Rhino model>)
Z = UnitZ(Factor=Slider(-0.461, range=-11..25))
timer = Timer(TimerInterval=1, Target=counter)  # disabled
counter = Counter(Reset=False)

values = Values(
    ClothedEdges=Slider(0.6, range=0.001..100),
    NakedEdges=Slider(0.25, range=0.001..100),
    SpringsStrength=Slider(10, range=0.001..100),
    HingeStrength=Slider(10, range=0.001..100),
    CollisionRadius=Slider(0.05, range=0.001..100),
    CollisionStrength=Slider(100, range=0.001..100),
    OffsetSpatialHash=Slider(4, range=0.001..100))
collision_box = CollisionBox(Mesh=mesh_3, Inflate=Slider(1, range=0.1..11.1), BinScale=Slider(1, range=0..1))  # -> BoundingBox, Subdivisions
mesh_6 = Mesh(mesh_4)

division = Division(A=counter, B=2000)
k2_pl = K2Plankton(
    Reset=Button(),
    On=Toggle(False),
    Mesh=mesh_6,
    Values=values,
    BoundingBox=collision_box.BoundingBox,
    Subdivisions=collision_box.Subdivisions,
    Threading=Toggle(False),
    ValenceX4Anchors=Toggle(True))

pt = Point(area.Centroid)
Z_2 = UnitZ(Factor=Slider(-11, range=-11..25))
move_3 = Move(Geometry=pt, Motion=Z_2)  # -> Geometry, Transform
circle = CircleCNR(Center=move_3.Geometry, Normal=Vector(0, 0, 1), Radius=Slider(34.547, range=0..305))
eval = EvaluateCurve(Curve=reparameterize(circle), Parameter=division)  # -> Point, Tangent, Angle

move_4 = Move(Geometry=pt, Motion=Z)  # -> Geometry, Transform

setcam = SetCamera(CameraLocation=eval.Point, TargetLocation=move_4.Geometry, Activate=True)

# ==== cluster Cluster
rad = ClusterInput()
platoocta = PlatonicOctahedron(Plane=PlaneXY(0, 0, 0), Radius=rad, Truncation=0)
platotetra = PlatonicTetrahedron(Plane=PlaneXY(0, 0, 0), Radius=rad, Truncation=0)
platocube = PlatonicCube(Plane=PlaneXY(0, 0, 0), Radius=rad, Truncation=0)
platoicosa = PlatonicIcosahedron(Plane=PlaneXY(0, 0, 0), Radius=rad, Truncation=0.38198)
platododec = PlatonicDodecahedron(Plane=PlaneXY(0, 0, 0), Radius=rad)
F = ClusterInput()
data = Data(platododec)
area = Area(Geometry=data)  # -> Area, Centroid
scale = Scale(Geometry=data, Center=area.Centroid, Factor=F)  # -> Geometry, Transform
debrep = DeconstructBrep(Brep=data)  # -> Faces, Edges, Vertices
debrep_2 = DeconstructBrep(Brep=scale.Geometry)  # -> Faces, Edges, Vertices
wires = BrepWireframe(Brep=debrep.Faces, Density=-1)
wires_2 = BrepWireframe(Brep=debrep_2.Faces, Density=-1)
D = ClusterInput()
join = JoinCurves(Curves=wires, Preserve=False)
join_2 = JoinCurves(Curves=wires_2, Preserve=False)
offset_l = OffsetLoose(Curve=join, Distance=D)
offset_l_2 = OffsetLoose(Curve=join_2, Distance=D)
explode = Explode(Curve=join, Recursive=True)  # -> graft(Segments), Vertices
explode_2 = Explode(Curve=offset_l_2, Recursive=True)  # -> graft(Segments), Vertices
explode_3 = Explode(Curve=offset_l, Recursive=True)  # -> graft(Segments), Vertices
explode_4 = Explode(Curve=join_2, Recursive=True)  # -> graft(Segments), Vertices
loft = Loft(
    Curves=[explode_3.Segments, explode.Segments],
    Options={Adjust=False, Closed=False, LoftEnds=0, LoftSimp=0, LoftType=0, Rebuild=10, Refit=0.01})
loft_2 = Loft(
    Curves=[explode_3.Segments, explode_2.Segments],
    Options={Adjust=False, Closed=False, LoftEnds=0, LoftSimp=0, LoftType=0, Rebuild=10, Refit=0.01})
loft_3 = Loft(
    Curves=[explode_2.Segments, explode_4.Segments],
    Options={Adjust=False, Closed=False, LoftEnds=0, LoftSimp=0, LoftType=0, Rebuild=10, Refit=0.01})
smesh = SimpleMesh(Brep=[loft, loft_2, loft_3])
M = ClusterOutput(smesh)
